# Grasshopper definition distribuicao de paineis autonomo.gh (Grasshopper 0.9.14)

domain = Domain(Domain(0.5782459469, 1.354875246))
pt = PointXYZ(XComponent=0, YComponent=0, ZComponent=0, System=PlaneXY(0, 0, 0))
num = Number(84.40411629)
arc = Arc(Plane=pt, Radius=num, Angle=domain)  # -> Arc, Length
multiplication = Multiplication(A=Slider(6, range=1..50), B=8)
divide = DivideCurve(Curve=arc.Arc, Count=multiplication, Kinks=False)  # -> Points, Tangents, Parameters
lng = ListLength(List=divide.Points)
cull_i = CullIndex(List=divide.Points, Indices=expr("I-1", lng), Wrap=False)
shift = ShiftList(List=divide.Points, Shift=1, Wrap=False)
Z = UnitZ(Factor=Slider(2.2, range=0..10))
move = Move(Geometry=shift, Motion=Z)  # -> Geometry, Transform
move_2 = Move(Geometry=cull_i, Motion=Z)  # -> Geometry, Transform
rec_3pt = Rectangle3Pt(PointA=shift, PointB=cull_i, PointC=move_2.Geometry)  # -> Rectangle, Length
offset = Offset(Curve=rec_3pt.Rectangle, Distance=1, Plane=PlaneXY(0, 0, 0), Corners=1)
