# Grasshopper definition distribuicao de paineis.gh (Grasshopper 0.9.14)

pt = Point(<point referenced from the Rhino model>)
pt_2 = Point(<point referenced from the Rhino model>)
pt_3 = Point(<point referenced from the Rhino model>)
vec2pt = Vector2Pt(PointA=pt_3, PointB=pt, Unitize=False)  # -> Vector, Length
vec2pt_2 = Vector2Pt(PointA=pt_3, PointB=pt_2, Unitize=False)  # -> Vector, Length
pt_4 = Point(<point referenced from the Rhino model>)
X = UnitX(Factor=1)
angle = Angle(VectorA=vec2pt.Vector, VectorB=X)  # -> Angle, Reflex
angle_2 = Angle(VectorA=vec2pt_2.Vector, VectorB=X)  # -> Angle, Reflex
dist = Distance(PointA=pt_4, PointB=pt_3)
dom = Domain(DomainStart=angle.Angle, DomainEnd=angle_2.Angle)
arc = Arc(Plane=pt_3, Radius=dist, Angle=dom)  # -> Arc, Length
multiplication = Multiplication(A=Slider(2, range=1..50), B=8)
divide = DivideCurve(Curve=arc.Arc, Count=multiplication, Kinks=False)  # -> Points, Tangents, Parameters
lng = ListLength(List=divide.Points)
shift = ShiftList(List=divide.Points, Shift=1, Wrap=False)
cull_i = CullIndex(List=divide.Points, Indices=expr("I-1", lng), Wrap=False)
ln = Line(StartPoint=cull_i, EndPoint=shift)
Z = UnitZ(Factor=Slider(4.1, range=0..10))
extr = Extrude(Base=ln, Direction=Z)
